vi "CLT.gvi"   [LabVIEW Communications System Design Suite 2.0.1]
panel controls:
  "milliseconds to wait": u32
  "number of bins": i32 = 10
  "number of bins_2": i32 = 10
panel indicators:
  "histogram": T1
  "loop iteration": i32
  "histogram_2": T1
types:
  T1 = cluster{"x values": f64[], "histogram h(x)": f64[]}
uses:
  NI::Analysis::Statistics::Histogram (single-shot)(DBL Array).gvi
diagram:
  s1 = f64[] []  # shift register
  while (iteration -> i1) {
    for (N = 4) {
      for (N = 5) {
        Random Number() -> (number (0 to 1)=w3)
        append w3 to w2
      }
      append w2 to w1
    }
    Add Array Elements(numeric array=w1) -> (sum=w4)
    Divide(x=w4, y=20) -> w5
    Insert Into Array(inArray=s1, index0=i1, new=w5) -> w6
    Subtract(x=w6, y=1) -> w7
    Divide(x=w7, y=1)
    call "Histogram (single-shot)(DBL Array).gvi"(signal=w6, number of bins=$"number of bins") -> (histogram=w8)
    $histogram <- w8
    Is Greater Or Equal(x=i1, y=1000) -> w9
    call "Histogram (single-shot)(DBL Array).gvi"(number of bins=$"number of bins_2") -> (histogram=w10)
    $histogram_2 <- w10
    Wait(time to wait=$"milliseconds to wait")
    $"loop iteration" <- i1
    next s1 = w6
    stop if w9
  }
