vi "Waveform.gvi"   [LabVIEW Communications System Design Suite 2.0.1]
panel controls:
  "frequency": f64 = 10
  "amplitude": f64 = 1
  "sample rate": f64 = 1000
  "samples": i32 = 1000
  "frequency_2": f64 = 10
  "amplitude_2": f64 = 1
  "sample rate_2": f64 = 1000
  "samples_2": i32 = 1000
  "frequency_3": f64 = 10
  "amplitude_3": f64 = 1
  "sample rate_3": f64 = 1000
  "samples_3": i32 = 1000
  "order": i32 = 2
  "low cutoff frequency": f64 = 0.125
  "high cutoff frequency": f64 = 0.45
panel indicators:
  "PSD After": T1
  "After Filter": waveform<f64>
  "Before Filter": waveform<f64>
  "PSD Before": T1
types:
  T1 = cluster{"f0": f64, "df": f64, "magnitude": f64[]}
uses:
  NI::Analysis::Generation::Sine Waveform.gvi
  NI::Analysis::Measurement::Power Spectral Density for 1 Chan.gvi
  NI::Analysis::Filtering::Butterworth Bandpass Filter (Waveform).gvi
diagram:
  call "Sine Waveform.gvi"(amplitude=$amplitude_3, frequency=$frequency_3, sample rate=$"sample rate_3", samples=$samples_3) -> (sine wave=w1)
  call "Sine Waveform.gvi"(amplitude=$amplitude, frequency=$frequency, sample rate=$"sample rate", samples=$samples) -> (sine wave=w2)
  call "Sine Waveform.gvi"(amplitude=$amplitude_2, frequency=$frequency_2, sample rate=$"sample rate_2", samples=$samples_2) -> (sine wave=w3)
  Waveform Add(w2, w3) -> w4
  Waveform Add(w4, w1) -> w5
  $"Before Filter" <- w5
  call "Power Spectral Density for 1 Chan.gvi"(signal=w5) -> (power spectral density=w6)
  $"PSD Before" <- w6
  call "Butterworth Bandpass Filter (Waveform).gvi"(signal=w5, high cutoff frequency=$"high cutoff frequency", low cutoff frequency=$"low cutoff frequency", order=$order) -> (filtered signal=w7)
  $"After Filter" <- w7
  call "Power Spectral Density for 1 Chan.gvi"(signal=w7) -> (power spectral density=w8)
  $"PSD After" <- w8
