vi "AMTopLevel.gvi"   [LabVIEW Communications System Design Suite 2.0.1]
panel controls:
  "msg frequency": f64 = 10
  "carrier frequency": f64 = 10
  "Am": f64 = 1
  "Ac": f64
  "sample rate msg": f64 = 1000
  "sample rate carrier": f64 = 1000
  "samples msg": i32 = 1000
  "samples carrier": i32 = 1000
  "stop": bool
  "order": i32 = 2
  "cutoff frequency": f64 = 0.125
panel indicators:
  "Message signal": waveform<f64>
  "AM waveform": waveform<f64>
  "PSD Envelope": T1
  "Demodulated envelope signal": waveform<f64>
  "Demodulated coherent": waveform<f64>
  "loop iteration": i32
  "PSD Coherent": T1
types:
  T1 = cluster{"f0": f64, "df": f64, "magnitude": f64[]}
diagram:
  while (iteration -> i1) {
    $"loop iteration" <- i1
    call "AM.gvi"(msg frequency=$"msg frequency", Am=$Am, carrier frequency=$"carrier frequency", Ac=$Ac, sample rate msg=$"sample rate msg", sample rate carrier=$"sample rate carrier", samples msg=$"samples msg", samples carrier=$"samples carrier") -> (Message signal (TIME)=w1, Carrier signal (TIME)=w2, AM waveform (time)=w3)
    call "AMEnvelopeDetection.gvi"(Input AM=w3, cutoff frequency=$"cutoff frequency", order=$order) -> (Output=w4, Demodulated signal=w5)
    call "AM coherent Block.gvi"(AM modulated=w3, cutoff frequency=$"cutoff frequency", Carry signal=w2, order=$order) -> (Demodulated - DC*2=w6, Demodulated - DC*2 PSD=w7)
    stop if $stop
  }
  $"AM waveform" <- w3
  $"PSD Envelope" <- w4
  $"Demodulated envelope signal" <- w5
  $"Message signal" <- w1
  $"Demodulated coherent" <- w6
  $"PSD Coherent" <- w7
