vi "FM_Modulator.gvi"   [LabVIEW Communications System Design Suite 2.0.1]
inputs:
  "MSG amplitude_2": f64 = 1
  "MSGsample rate_2": f64 = 1000
  "MSG Signal": waveform<f64> = {dt=1, Y=[]}
  "MSG frequency_2": f64 = 10
  "MSG Sample_2": i32 = 1000
  "Freq Deviation": f64
outputs:
  "FM Output": waveform<f64>[]
uses:
  NI::Analysis::Generation::Sine Waveform.gvi
  NI::Analysis::IntegralDifferentiation::Integral x(t).gvi
diagram:
  call "Sine Waveform.gvi"(amplitude=$"MSG amplitude_2", frequency=$"MSG frequency_2", phase in=0, sample rate=$"MSGsample rate_2", samples=$"MSG Sample_2") -> (sine wave=w1)
  Property Node(instance in=$"MSG Signal") -> ("Y"=w2, "dt"=w3)
  call "Integral x(t).gvi"(x(t)=w2, dt=w3) -> (integral x(t)=w4)
  Multiply(PiTimes2, $"Freq Deviation") -> w5
  Multiply(w5, w4) -> w6
  Sine And Cosine(x=w6) -> (cos(x)=w7, sin(x)=w8)
  Waveform Multiply(w8, w1) -> w9
  call "Sine Waveform.gvi"(amplitude=$"MSG amplitude_2", frequency=$"MSG frequency_2", phase in=90, sample rate=$"MSGsample rate_2", samples=$"MSG Sample_2") -> (sine wave=w10)
  Waveform Multiply(w7, w10) -> w11
  Waveform Subtract(x=w11, y=w9) -> w12
  $"FM Output" <- w12
