vi "Top Level FM.gvi"   [LabVIEW Communications System Design Suite 2.0.1]
panel controls:
  "MSG amplitude": f64 = 1
  "MSG frequency": f64 = 10
  "MSG phase in": f64
  "MSGsample rate": f64 = 1000
  "Freq Dev": f64
  "MSG Sample": i32 = 1000
  "Carrier Sample_2": i32 = 1000
  "Carrier amplitude_2": f64 = 1
  "Carrier sample rate_2": f64 = 1000
  "MCarrier frequency_2": f64 = 10
panel indicators:
  "FM Output": waveform<f64>[]
  "Signal": waveform<f64>
uses:
  NI::Analysis::Generation::Sine Waveform.gvi
diagram:
  call "Sine Waveform.gvi"(amplitude=$"MSG amplitude", frequency=$"MSG frequency", phase in=$"MSG phase in", sample rate=$"MSGsample rate", samples=$"MSG Sample") -> (sine wave=w1)
  call "FM_Modulator.gvi"(MSG amplitude_2=$"Carrier amplitude_2", MSGsample rate_2=$"Carrier sample rate_2", MSG Signal=w1, MSG frequency_2=$"MCarrier frequency_2", MSG Sample_2=$"Carrier Sample_2", Freq Deviation=$"Freq Dev") -> (FM Output=w2)
  $"FM Output" <- w2
  $Signal <- w1
